# Grasshopper definition Modelo_ABM_Humedal_Jaboque_pt2.gh (Grasshopper 1.0.8)
# plug-ins: Human, BitmapPlus, OpenNest, Moonlight, Bifocals, LunchBox, Nursery

# ----
# MÓDULO 1: Entrada de datos (listas y entorno)
file = ReadFile(File="C:\Users\USUARIO\Downloads\observations-563401_a.csv", PerLineParse=True)
cull_i = CullIndex(List=file, Indices="0", Wrap=Toggle(True))
panel = Panel("""id
uuid
observed_on_string
observed_on
time_observed_at
time_zone
user_id
user_login
user_name
created_at
updated_at
quality_grade
license
url
image_url
sound_url
tag_list
description
num_identification_agreements
num_identification_disagreements
captive_cultivated
oauth_application_id
place_guess
latitude
longitude
positional_accuracy
private_place_guess
private_latitude
private_longitude
public_positional_accuracy
geoprivacy
taxon_geoprivacy
coordinates_obscured
positioning_method
positioning_device
scientific_name
common_name
iconic_taxon_name
taxon_id
taxon_kingdom_name
taxon_phylum_name
taxon_superclass_name
taxon_class_name
taxon_order_name
taxon_family_name
taxon_genus_name
taxon_species_name""")
split = TextSplit(Text=cull_i, Separators=";", SplitOptions=0)
tag = SplitList(List=split, Index="0")  # -> ListA, ESPECIE
item = ListItem(List=tag.ESPECIE, Index=0, Wrap=True)  # -> Item, Item1, Item2, Item3, Item4, Item5, Item6, Item7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

# ----
# PRE-SET DEL ENTORNO
toggle = BooleanToggle(True)
moonlight = Moonlight(Mode=toggle)

pt = Point(Point(4097.530158, 4402.417219, 0))
xy = XYPlane(Origin=pt)
text = Text(Location=xy, Text="PAISAJES BIO-COMPUTACIONALES EN EL HUMEDAL JABOQUE", Size=Slider(100, range=0..100))
crv = Curve(text)

panel_2 = Panel("C:\Users\USUARIO\Downloads\Picture2.jpg")

# ----
# MÓDULO 2: Entorno de simulacion
panel_3 = Panel("E:\jb proyectual\jaboque base.jpg")
pt_2 = Point(Point(0, 0, 0))
bitmap = BitmapFromFile(BitmapPath=panel_3)  # -> Bitmap, Width, Height
xy_2 = XYPlane(Origin=pt_2)
rectangle = Rectangle(Plane=xy_2, XSize=bitmap.Width, YSize=bitmap.Height, Radius=0)  # -> Rectangle, Length
srf = Surface(rectangle.Rectangle)
previewmat = CustomPreviewMaterials(Geometry=srf, DiffuseColor=RGB(255, 255, 255), DiffuseBitmap=panel_2, TransparencyBitmap=panel_2)
grid = GridStructure(Surface=srf, UDivisions=Slider(20, range=0..100), VDivisions=10)  # -> StructureLines, StructureNodes
colour = ColourPicker(PickedColour=RGB(255, 255, 255))
pt_3 = Point(grid.StructureNodes)
crv_2 = Curve(grid.StructureLines)
panel_4 = Panel("""20
10""")
dash = DashPattern(Curve=crv_2, Pattern=panel_4)  # -> Dashes, Gaps
preview = CustomPreview(Geometry=[dash.Gaps, rectangle.Rectangle, pt_3, crv], Material=colour)

openbmp = OpenBitmap(FilePath="C:\Users\USUARIO\Downloads\Picture1.jpg", Load=Toggle(True))
previmg = PrevImage(SmartBitmap=openbmp)
addition = Addition(A=Slider(171, range=0..1000), B=bitmap.Height)
cropimg = CropImage(Image=openbmp, Region=rectangle.Rectangle, KeepOriginal=True, Color=RGBA(255, 255, 255, 0))
resizeimg = ResizeImage(Image=cropimg, Mode=0, Width=bitmap.Width, Height=addition)
colour_2 = ColourPicker(PickedColour=RGBA(56, 56, 56, 36))
trace = TraceBitmap(Image=resizeimg, Mode=0, Size=2, Error=0.2, Threshold=Slider(0.632, range=0..1), Alpha=Slider(0.073, range=0..1))
crv_3 = Curve(trace)
preview_2 = CustomPreview(Geometry=crv_3, Material=colour_2)

panel_5 = Panel(item.Item35)
panel_6 = Panel(item.Item23)
panel_7 = Panel(item.Item24)
Y = UnitY(Factor=Slider(972, range=0..1000))

# ----
# Passeriformes
number_slider = Slider(1, range=0..1)
pop2d = Populate2D(Region=srf, Count=Slider(4292, range=0..10000), Seed=1)
xy_3 = XYPlane(Origin=pop2d)
brownian = BrownianMotion(Strength=number_slider, XY=True, Priority=0)
integrate = Integrate(Damping=1, Priority=100)
particle = Particle(xy_3)
behaviour = Behaviour([brownian, integrate])
agent = Agent(particle)
setbehaviours = SetBehaviours(Agents=agent, Behaviours=behaviour)
createpop = CreatePopulation(Agents=setbehaviours)
sim = Simulate(Agents=flatten(createpop), SolverSteps=1)
item_2 = ListItem(List=sim, Index=1, Wrap=True)
deagentlist = DeconstructAgentList(AgentList=item_2)
deagent = DeconstructAgent(Agent=deagentlist)
colour_3 = ColourPicker(PickedColour=RGB(255, 0, 0))
plane3d = Plane3D(deagent)
pln = Plane(plane3d)
symsim = SymbolSimple(Style=12, Size=Slider(7, range=0..100), Rotation=0, Colour=colour_3)
pt_4 = Point(pln)
symbol = SymbolDisplay(Location=pt_4, Display=symsim)

pt_5 = Point(Point(3547.158287, 2807.378419, 0))
move = Move(Geometry=pt_5, Motion=Y)  # -> Geometry, Transform

drawneighbours = DrawNeighbours(Agents=agent)
item_3 = ListItem(List=sim, Index=1, Wrap=True)
deagentlist_2 = DeconstructAgentList(AgentList=item_3)
deagent_2 = DeconstructAgent(Agent=deagentlist_2)
plane3d_2 = Plane3D(deagent_2)
pln_2 = Plane(plane3d_2)
cir = Circle(Plane=pln_2, Radius=expr("x/2", Slider(11, range=0..100)))

# ---- group: Double click timer to run simulation
timer = Timer(Interval=5, TimerInterval=5, Target=[sim_2, sim_4, sim_3, sim, sim_5])  # disabled

# ---- group: Interaction behaviours
number_slider_2 = Slider(2.2, range=0..10)
attract = Attract(
    Strength=Slider(0.01, range=0..0.01),
    MinDistance=Slider(0.7, range=0..10),
    MaxDistance=number_slider_2,
    InXY=False,
    Falloff=2,
    Priority=0)
repel = Repel(
    Strength=Slider(0.095, range=0..0.1),
    MinDistance=0,
    MaxDistance=Slider(1.2, range=0..10),
    InXY=False,
    Falloff=2,
    Priority=0)
alignplanes = AlignToPlanes(Strength=Slider(0.59, range=0..1), MaxDistance=Slider(2, range=0..10), Priority=2)

# ---- group: Global behaviours
crv_4 = Curve([<curve referenced from the Rhino model> x5])
c_curve_attraction = CSharpScript(
    curves=crv_4,
    strength=Slider(0.0105, range=0..0.1),
    minDist=Slider(4.15, range=0..10),
    maxDist=Slider(20, range=0..100),
    priority=Slider(0, range=0..100),
    Reference=["C:\USERS\USUARIO\APPDATA\ROAMING\GRASSHOPPER\LIBRARIES\NURSERY065\SlowRobotics.dll", "C:\USERS\USUARIO\APPDATA\ROAMING\GRASSHOPPER\LIBRARIES\NURSERY065\Toxiclibs.dll"])  # -> out, A; inputs curves: list of Curve, strength: Double, minDist: Double, maxDist: Double, priority: Int32
# ---------- c_curve_attraction: C# ----------
    A = new CurveAttract (curves, (float) strength, (float) minDist, (float) maxDist, priority);
# ---------- c_curve_attraction: C# additional code ----------
  public class CurveAttract : ScaledBehaviour<SRParticle>{
    List<Curve>curves;
    float strength;
    float minDist;
    float maxDist;

    public CurveAttract(List<Curve> _curves, float _strength, float _min, float _max, int _p):base(_p){
      curves = _curves;
      strength = _strength;
      minDist = _min;
      maxDist = _max;
      cleanup();
    }

    public void cleanup(){
      curves.RemoveAll(x => x == null);
    }

    public override void runOn(SRParticle p){

      foreach(Curve c in curves){
        double t = 0;
        c.ClosestPoint(p.ToPoint3d(), out t);
        Vector3d toPt = c.PointAt(t) - p.ToPoint3d();
        double d = toPt.Length;
        if(d > minDist && d < maxDist){
          toPt *= (strength / d);
          p.addForce(toPt.ToVec3D());
        }
      }
    }

  }
# ---------- end c_curve_attraction ----------
alignvelocity = AlignToVelocity(Strength=Slider(0.19, range=0..1), Axis=0, Priority=8)
moveaxis = MoveInAxis(Axis=0, Strength=Slider(0.08, range=0..1), Priority=0)

# ----
pt_6 = Point([Point(-90.79889396, 30.86053109, 0), Point(-7.518631797, -86.31394304, 0), Point(31.67240089, -27.17672148, 0), Point(59.29722102, 25.99160342, 0), Point(70.41120408, 117.9039475, 0), Point(19.91387674, 142.1173084, 0)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])
R = Region(rectangle.Rectangle)
c_randompts = CSharpScript(x=R, y=Slider(10000, range=0..10000))  # -> out, A; inputs x: Box, y: Int32
# ---------- c_randompts: C# ----------
    List<Point3d> pts = new List<Point3d>();
    for(int i = 0;i < y;i++){
      pts.Add(new Point3d(x.PointAt(r.NextDouble(), r.NextDouble(), r.NextDouble())));
    }

    A = pts;
# ---------- c_randompts: C# additional code ----------
  Random r = new Random();
# ---------- end c_randompts ----------
xy_4 = XYPlane(Origin=c_randompts.A)
xy_5 = XYPlane(Origin=pt_5)
attract_2 = Attract(
    Strength=Slider(2.341, range=0..10),
    MinDistance=Slider(7.42, range=0..10),
    MaxDistance=Slider(10000, range=0..10000),
    InXY=False,
    Falloff=2,
    Priority=0)
repel_2 = Repel(
    Strength=Slider(0.07, range=0..1),
    MinDistance=Slider(0, range=0..10),
    MaxDistance=Slider(6.18, range=0..10),
    InXY=False,
    Falloff=2,
    Priority=0)
interact = Interact(Behaviours=[attract_2, repel_2], Priority=2)
integrate_2 = Integrate(Damping=1, Priority=20)
particle_2 = Particle(xy_5)
particle_3 = Particle(xy_4)
agent_2 = Agent(particle_2)
agent_3 = Agent(particle_3)

pointcollection = CreatePointCollection()
rebuild = RebuildTree(Agents=agent_2, Priority=5)
agent_4 = Agent(pointcollection)
replacebehaviours = ReplaceBehaviours(Agents=agent_4, Behaviours=rebuild)
createpop_2 = CreatePopulation(Agents=replacebehaviours)

search = Search(Radius=Slider(1000, range=0..1000), Structure=pointcollection, NumPoints=255, Priority=0)
behaviour_2 = Behaviour([interact, integrate_2, search])
replacebehaviours_2 = ReplaceBehaviours(Agents=agent_3, Behaviours=behaviour_2)
createpop_3 = CreatePopulation(Agents=flatten([replacebehaviours_2, agent_2]))

sim_2 = Simulate(Agents=flatten([createpop_2, createpop_3]), SolverSteps=1)

number_slider_3 = Slider(6, range=0..10)
attract_3 = Attract(
    Strength=Slider(0.028, range=0..0.1),
    MinDistance=Slider(0, range=0..10),
    MaxDistance=Slider(100, range=0..100),
    InXY=False,
    Falloff=1,
    Priority=0)
repel_3 = Repel(
    Strength=Slider(0.07, range=0..1),
    MinDistance=Slider(0, range=0..10),
    MaxDistance=number_slider_3,
    InXY=False,
    Falloff=2,
    Priority=1)
interact_2 = Interact(Behaviours=[repel_3, attract_3], Priority=2)
integrate_3 = Integrate(Damping=Slider(1, range=0..1), Priority=20)

R_2 = Region({Plane=PlaneXY(25.39070579, 12.65734267, 0), Size=Domain2(u=-24.45003302..24.45003302, v=-13.29540966..13.29540966)})
pop2d_2 = Populate2D(Region=R_2, Count=Slider(31, range=0..1000), Seed=1)
xy_6 = XYPlane(Origin=pop2d_2)
rotate = CSharpScript(x=xy_6)  # -> out, A; inputs x: Plane
# ---------- rotate: C# ----------
    x.Rotate(r.NextDouble(), x.ZAxis);
    A = x;
# ---------- rotate: C# additional code ----------
  Random r = new Random();
# ---------- end rotate ----------
createparticle = CreateParticle(Plane=rotate.A, Mass=Slider(5, range=0..10), Length=Slider(2.13, range=0..10), Radius=0)
agent_5 = Agent(createparticle)

# ----
# Rodentia
number_slider_4 = Slider(100, range=0..100)
pop2d_3 = Populate2D(Region=srf, Count=100, Seed=number_slider_4)
xy_7 = XYPlane(Origin=pop2d_3)
brownian_2 = BrownianMotion(Strength=Slider(1, range=0..1), XY=True, Priority=0)
integrate_4 = Integrate(Damping=1, Priority=100)
particle_4 = Particle(xy_7)
behaviour_3 = Behaviour([brownian_2, integrate_4])
agent_6 = Agent(particle_4)
setbehaviours_2 = SetBehaviours(Agents=agent_6, Behaviours=behaviour_3)
createpop_4 = CreatePopulation(Agents=setbehaviours_2)
sim_3 = Simulate(Agents=flatten(createpop_4), SolverSteps=1)
drawneighbours_2 = DrawNeighbours(Agents=sim_3)
item_4 = ListItem(List=sim_3, Index=1, Wrap=True)
deagentlist_3 = DeconstructAgentList(AgentList=item_4)
deagent_3 = DeconstructAgent(Agent=deagentlist_3)
colour_4 = ColourPicker(PickedColour=RGB(153, 0, 255))
plane3d_3 = Plane3D(deagent_3)
pln_3 = Plane(plane3d_3)
symsim_2 = SymbolSimple(Style=7, Size=Slider(8, range=0..100), Rotation=0, Colour=colour_4)
pt_7 = Point(pln_3)

kdtree = CreateKDTree()
agent_7 = Agent(kdtree)

search_2 = Search(Radius=Slider(20, range=0..100), Structure=kdtree, NumPoints=255, Priority=0)
behaviour_4 = Behaviour([interact_2, integrate_3, search_2])

setbehaviours_3 = SetBehaviours(Agents=agent_5, Behaviours=behaviour_4)

createpop_5 = CreatePopulation(Agents=setbehaviours_3)
rebuild_2 = RebuildTree(Agents=createpop_5, Priority=0)
replacebehaviours_3 = ReplaceBehaviours(Agents=agent_7, Behaviours=rebuild_2)
sim_4 = Simulate(Agents=flatten([replacebehaviours_3, createpop_5]), SolverSteps=Slider(10, range=0..10))
drawneighbours_3 = DrawNeighbours(Agents=sim_4)
item_5 = ListItem(List=sim_4, Index=1, Wrap=True)
deagentlist_4 = DeconstructAgentList(AgentList=item_5)
deagent_4 = DeconstructAgent(Agent=deagentlist_4)
plane3d_4 = Plane3D(deagent_4)
pln_4 = Plane(plane3d_4)
cir_2 = Circle(Plane=pln_4, Radius=expr("x/2", number_slider_3))

kdtree_2 = CreateKDTree()
interact_3 = Interact(Behaviours=[attract, repel, alignplanes], Priority=0)
search_3 = Search(Radius=number_slider_2, Structure=kdtree_2, NumPoints=255, Priority=0)
integrate_5 = Integrate(Damping=Slider(0.7, range=0..1), Priority=100)
behaviour_5 = Behaviour([interact_3, integrate_5, alignvelocity, moveaxis, c_curve_attraction.A, search_3])
timer_2 = Timer(Interval=20, TimerInterval=20, Target=sim_6)  # disabled

neg = Negative(Value=Slider(100, range=0..100))

# ----
# Insectos (Diptera, Lepidoptera, etc.)
number_slider_5 = Slider(71, range=0..100)
pop2d_4 = Populate2D(Region=srf, Count=100, Seed=number_slider_5)
xy_8 = XYPlane(Origin=pop2d_4)
brownian_3 = BrownianMotion(Strength=Slider(1, range=0..1), XY=True, Priority=0)
integrate_6 = Integrate(Damping=1, Priority=100)
particle_5 = Particle(xy_8)
behaviour_6 = Behaviour([brownian_3, integrate_6])
agent_8 = Agent(particle_5)
setbehaviours_4 = SetBehaviours(Agents=agent_8, Behaviours=behaviour_6)
createpop_6 = CreatePopulation(Agents=setbehaviours_4)
sim_5 = Simulate(Agents=flatten(createpop_6), SolverSteps=1)
drawneighbours_4 = DrawNeighbours(Agents=sim_5)
item_6 = ListItem(List=sim_5, Index=1, Wrap=True)
deagentlist_5 = DeconstructAgentList(AgentList=item_6)
colour_5 = ColourPicker(PickedColour=RGB(0, 212, 255))
deagent_5 = DeconstructAgent(Agent=deagentlist_5)
plane3d_5 = Plane3D(deagent_5)
pln_5 = Plane(plane3d_5)
pt_8 = Point(pln_5)

symbol_2 = SymbolDisplay(Location=[pt_8, pt_7], Display=symsim_2)

symsim_3 = SymbolSimple(Style=5, Size=Slider(6, range=0..100), Rotation=0, Colour=colour_5)

symbol_3 = SymbolDisplay(Location=pt_8, Display=symsim_3)

Z = UnitZ(Factor=neg)
extr = Extrude(Base=rectangle.Rectangle, Direction=Z)
box = Box(extr)

# ---- group: Creating initial particles
c_randompts_2 = CSharpScript(x=box, y=Slider(3742, range=0..10000))  # -> out, A; inputs x: Box, y: Int32; same code as c_randompts
randvector = CSharpRandomGenerator(list=c_randompts_2.A)  # -> out, A
# ---------- randvector: C# ----------
    A = new Vector3d(randomizer.NextDouble()-0.5, randomizer.NextDouble()-0.5, randomizer.NextDouble()-0.5);
# ---------- randvector: C# additional code ----------
  Random randomizer = new Random();
# ---------- end randvector ----------
pl = PlaneNormal(Origin=c_randompts_2.A, ZAxis=randvector.A)
createparticle_2 = CreateParticle(Plane=pl, Mass=Slider(0.26, range=0..10), Length=0, Radius=0)

# ---- group: Creating trails using a graph
graph = Graph(createparticle_2)
agent_9 = Agent(graph)
c_reset = CSharpScript(
    x=box,
    y=box,
    Reference=["C:\USERS\USUARIO\APPDATA\ROAMING\GRASSHOPPER\LIBRARIES\NURSERY065\SlowRobotics.dll", "C:\USERS\USUARIO\APPDATA\ROAMING\GRASSHOPPER\LIBRARIES\NURSERY065\Toxiclibs.dll"])  # -> out, A; inputs x: Box, y: Box
# ---------- c_reset: C# ----------
    A = new ResetBehaviour(5, x, y);
# ---------- c_reset: C# additional code ----------
  public class ResetBehaviour : Behaviour<Graph<SRParticle,Spring>>{
    Box a,b;
    Random r = new Random();

    public ResetBehaviour(int _p, Box _a, Box _b):base(_p){
      a = _a;
      b = _b;
    }
    public override void runOn(Graph<SRParticle,Spring> g){
      //get lead particle
      SRParticle p = g.parent;
      if(!a.Contains(p.ToPoint3d())){
        Point3d newP = b.PointAt(r.NextDouble(), r.NextDouble(), r.NextDouble());
        // Point3d newP = new Point3d(r.NextDouble() * 50, r.NextDouble() * 50, r.NextDouble() * 20);
        p.set(newP.ToVec3D());
        g.clear();
        g.insert(p);
      }
    }
  }
# ---------- end c_reset ----------
springtrail = LeaveSpringTrail(OffsetVector=Vector(0, 0, 1), Stiffness=0.15, AddFrequency=Slider(28, range=0..100), Priority=0, Reset=Button())  # -> Behaviour, NewAgents
setbehaviours_5 = SetBehaviours(Agents=agent_9, Behaviours=[springtrail.Behaviour, c_reset.A])
createpop_7 = CreatePopulation(Agents=setbehaviours_5)

# ----
agent_10 = Agent(createparticle_2)
setbehaviours_6 = SetBehaviours(Agents=agent_10, Behaviours=behaviour_5)
createpop_8 = CreatePopulation(Agents=setbehaviours_6)

# ---- group: Rebuilding spatial tree
rebuild_3 = RebuildTree(Agents=createpop_8, Priority=0)
agent_11 = Agent(kdtree_2)
setbehaviours_7 = SetBehaviours(Agents=agent_11, Behaviours=rebuild_3)
createpop_9 = CreatePopulation(Agents=setbehaviours_7)

# ----
sim_6 = Simulate(Agents=flatten([createpop_8, createpop_9, createpop_7]), SolverSteps=1)  # disabled
